# Grasshopper definition 004_pavilhao_madeira.gh (Grasshopper 1.0.8)

# ---- group: 00 | PARAMETROS DIMENSIONAIS (SLIDERS)
r_base = Slider(2700, range=1500..4500)
h_total = Slider(2700, range=1800..4000)
h_livre = Slider(2100, range=1400..3000)
num_arcos = Slider(18, range=8..48)
espessura = Slider(18, range=10..40)
w_secao_base = Slider(250, range=120..400)
w_secao_topo = Slider(140, range=60..220)
r_core = Slider(340, range=200..600)
r_tambor = Slider(900, range=600..1500)
r_furo = Slider(300, range=150..500)
h_soco = Slider(200, range=50..350)
angulo_abertura = Slider(180, range=10..360)
descida_membrana = Slider(0.7, range=0.1..1)
num_estantes = Slider(6, range=2..12)
num_travessas = Slider(10, range=3..24)
raio_purlin = Slider(22, range=10..40)
puxar_dx = Slider(0, range=-1500..1500)
puxar_dy = Slider(0, range=-1500..1500)
puxar_dz = Slider(0, range=-1500..1500)
raio_influencia = Slider(2800, range=500..5000)
tolerancia_cnc = Slider(0.5, range=0..2)
espacamento_2d = Slider(400, range=100..1000)

# ---- group: 01 | GRAFOS DE CONTROLO FORMAL (GRAPH MAPPERS)
range_perfil = Range(Domain=Domain(0, 1), Steps=10)
range_taper = Range(Domain=Domain(0, 1), Steps=10)
range_estantes = Range(Domain=Domain(0, 1), Steps=num_estantes)
grafo_perfil = GraphMapper(range_perfil, x0=0, x1=1, y0=0, y1=1, container_name="Bezier", cpx=[0, 0.25, 0.75, 1], cpy=[0, 0.25, 0.75, 1])
grafo_taper = GraphMapper(range_taper, x0=0, x1=1, y0=0, y1=1, container_name="Bezier", cpx=[0, 0.25, 0.75, 1], cpy=[0, 0.25, 0.75, 1])
grafo_estantes = GraphMapper(range_estantes, x0=0, x1=1, y0=0, y1=1, Ox=0.5, Oy=0, Px=0.75, Py=0.25, container_name="Parabola")

# ---- group: 03 | SHADERS & MATERIAIS DE VISUALIZACAO
cor_arcos = ColourSwatch(SwatchColor=RGB(225, 175, 105))
cor_estantes = ColourSwatch(SwatchColor=RGB(238, 200, 150))
cor_base_redonda = ColourSwatch(SwatchColor=RGB(210, 175, 130))
cor_travessas = ColourSwatch(SwatchColor=RGB(200, 160, 110))
cor_membrana = ColourSwatch(SwatchColor=RGB(248, 250, 255))

# ---- group: 04 | FABRICO CNC 2D & AUDITORIA ESTRUTURAL
ativar_2d_cnc = BooleanToggle(False)

# ---- group: 02 | MOTOR COMPUTACIONAL NATIVO (RHINOCOMMON)
pavilhao_solver_3d = GhPythonScript(
    R_Base=r_base,
    H_Livre=h_livre,
    H_Total=h_total,
    Num_Arcos=num_arcos,
    Espessura=espessura,
    W_Secao_Base=w_secao_base,
    W_Secao_Topo=w_secao_topo,
    R_Core=r_core,
    R_Tambor=r_tambor,
    R_Furo=r_furo,
    H_Soco=h_soco,
    Angulo_Abertura=angulo_abertura,
    Descida_Membrana=descida_membrana,
    Num_Estantes=num_estantes,
    Num_Travessas=num_travessas,
    Raio_Purlin=raio_purlin,
    Puxar_DX=puxar_dx,
    Puxar_DY=puxar_dy,
    Puxar_DZ=puxar_dz,
    Raio_Influencia=raio_influencia,
    Tolerancia_CNC=tolerancia_cnc,
    Espacamento_2D=espacamento_2d,
    Ativar_2D_CNC=ativar_2d_cnc,
    Grafo_Perfil=grafo_perfil,
    Grafo_Taper=grafo_taper,
    Grafo_Estantes=grafo_estantes)  # -> out, Arcos, Estantes, Base_Redonda, Travessas, Membrana, Metricas, Placas_CNC_2D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; inputs Grafo_Perfil: list, Grafo_Taper: list, Grafo_Estantes: list
#   port R_Base: Parametro R_Base
#   port H_Livre: Parametro H_Livre
#   port H_Total: Parametro H_Total
#   port Num_Arcos: Parametro Num_Arcos
#   port Espessura: Parametro Espessura
#   port W_Secao_Base: Parametro W_Secao_Base
#   port W_Secao_Topo: Parametro W_Secao_Topo
#   port R_Core: Parametro R_Core
#   port R_Tambor: Parametro R_Tambor
#   port R_Furo: Parametro R_Furo
#   port H_Soco: Parametro H_Soco
#   port Angulo_Abertura: Parametro Angulo_Abertura
#   port Descida_Membrana: Parametro Descida_Membrana
#   port Num_Estantes: Parametro Num_Estantes
#   port Num_Travessas: Parametro Num_Travessas
#   port Raio_Purlin: Parametro Raio_Purlin
#   port Puxar_DX: Parametro Puxar_DX
#   port Puxar_DY: Parametro Puxar_DY
#   port Puxar_DZ: Parametro Puxar_DZ
#   port Raio_Influencia: Parametro Raio_Influencia
#   port Tolerancia_CNC: Parametro Tolerancia_CNC
#   port Espacamento_2D: Parametro Espacamento_2D
#   port Ativar_2D_CNC: Parametro Ativar_2D_CNC
#   port Grafo_Perfil: Parametro Grafo_Perfil
#   port Grafo_Taper: Parametro Grafo_Taper
#   port Grafo_Estantes: Parametro Grafo_Estantes
#   port Arcos: Geometria Arcos
#   port Estantes: Geometria Estantes
#   port Base_Redonda: Geometria Base_Redonda
#   port Travessas: Geometria Travessas
#   port Membrana: Geometria Membrana
#   port Metricas: Geometria Metricas
#   port Placas_CNC_2D: Geometria Placas_CNC_2D
#   port Encaixes_CNC_2D: Geometria Encaixes_CNC_2D
#   port Rotulos_CNC_2D: Geometria Rotulos_CNC_2D
#   port Chapas_CNC_2D: Geometria Chapas_CNC_2D
# ---------- pavilhao_solver_3d: Python ----------
"""
GHPython Component for Grasshopper (Rhino 8)
PROJETO DE EXECUÃÃO: PAVILHÃO DE MADEIRA (PARAMÃTRICO 100%)
Arquitetura Fiel: Zero amarraÃ§Ãµes a atravessar o vÃ£o livre.
Estantes de livros interlocking em nichos curvos entre nervuras.
Controlo absoluto via Sliders e 3 Graph Mappers (BÃ©zier Profile, Taper, Shelves).

Inputs:
    R_Base (float): Raio exterior do pavilhÃ£o no solo (default: 2700.0)
    H_Livre (float): Altura de passagem/ombro frontal (default: 2100.0)
    H_Total (float): Altura mÃ¡xima no zÃ©nite da abÃ³bada (default: 2700.0)
    Num_Arcos (int): NÃºmero de nervuras radiais em leque (default: 18)
    Espessura (float): Espessura das peÃ§as de madeira (default: 18.0)
    W_Secao_Base (float): Profundidade da nervura na base/estante (default: 250.0)
    W_Secao_Topo (float): Profundidade da nervura no cume (default: 140.0)
    R_Core (float): Raio onde os arcos nascem no tambor central (default: 340.0)
    R_Tambor (float): Raio exterior do plinto de madeira (default: 900.0)
    R_Furo (float): Raio do furo circular central do plinto (default: 300.0)
    H_Soco (float): Altura do tambor/plinto (default: 200.0)
    Angulo_Abertura (float): Ãngulo de abertura do leque (10.0 a 360.0 graus, default: 180.0)
    Descida_Membrana (float): Percentagem de descida da tela (0.10 a 1.00, default: 0.70)
    Num_Estantes (int): Quantidade de nÃ­veis de prateleiras (default: 6)
    Num_Travessas (int): Quantidade de purlins transversais (default: 10)
    Raio_Purlin (float): Raio da barra/tubo dos purlins (default: 22.0)
    Puxar_DX (float): Deslocamento X do puxador elÃ¡stico (default: 0.0)
    Puxar_DY (float): Deslocamento Y do puxador elÃ¡stico (default: 0.0)
    Puxar_DZ (float): Deslocamento Z do puxador elÃ¡stico (default: 0.0)
    Raio_Influencia (float): Raio da deformaÃ§Ã£o elÃ¡stica contÃ­nua (default: 2800.0)
    Tolerancia_CNC (float): Folga milimÃ©trica nos encaixes de corte (default: 0.5)
    Espacamento_2D (float): Afastamento entre peÃ§as na planificaÃ§Ã£o (default: 400.0)
    Grafo_Perfil (list of float): Grafo BÃ©zier para curvatura/elevaÃ§Ã£o do arco
    Grafo_Taper (list of float): Grafo BÃ©zier para variaÃ§Ã£o de secÃ§Ã£o da madeira
    Grafo_Estantes (list of float): Grafo para distribuiÃ§Ã£o das prateleiras

Outputs:
    Arcos (list of Brep): Nervuras lameladas contÃ­nuas 3D
    Estantes (list of Brep): Nichos de prateleira modulares 3D
    Base_Redonda (list of Brep): Plinto cilÃ­ndrico anular de suporte 3D
    Travessas (list of Brep): Purlins curvos de suporte da tela 3D
    Membrana (list of Mesh): Tela translÃºcida envolvente 3D
    Metricas (list of str): Painel de cÃ¡lculo de materiais e Ã¡reas
    Placas_CNC_2D (list of Brep): PeÃ§as 2D prontas para corte CNC
    Encaixes_CNC_2D (list of Curve): Rasgos de encaixe com tolerÃ¢ncia
    Rotulos_CNC_2D (list of TextEntity): Etiquetas numeradas dos arcos
    Chapas_CNC_2D (list of Curve): Limites retangulares de corte
"""

import math
import Rhino
import Rhino.Geometry as rg

# -------------------------------------------------------------
# 1. PARÃMETROS COM VALORES DEFAULT RESILIENTES
# -------------------------------------------------------------
R_Base = float(R_Base) if 'R_Base' in globals() and R_Base is not None else 2700.0
H_Livre = float(H_Livre) if 'H_Livre' in globals() and H_Livre is not None else 2100.0
H_Total = float(H_Total) if 'H_Total' in globals() and H_Total is not None else 2700.0
Num_Arcos = int(Num_Arcos) if 'Num_Arcos' in globals() and Num_Arcos is not None else 18
Espessura = float(Espessura) if 'Espessura' in globals() and Espessura is not None else 18.0

if 'W_Secao_Base' in globals() and W_Secao_Base is not None:
    W_Estante = float(W_Secao_Base)
elif 'W_Estante' in globals() and W_Estante is not None:
    W_Estante = float(W_Estante)
else:
    W_Estante = 250.0

if 'W_Secao_Topo' in globals() and W_Secao_Topo is not None:
    W_Topo = float(W_Secao_Topo)
elif 'W_Topo' in globals() and W_Topo is not None:
    W_Topo = float(W_Topo)
else:
    W_Topo = 140.0

R_Core = float(R_Core) if 'R_Core' in globals() and R_Core is not None else 340.0
R_TAMBOR = float(R_Tambor) if 'R_Tambor' in globals() and R_Tambor is not None else 900.0
R_FURO = float(R_Furo) if 'R_Furo' in globals() and R_Furo is not None else 300.0
H_Soco = float(H_Soco) if 'H_Soco' in globals() and H_Soco is not None else 200.0

Angulo_Abertura = float(Angulo_Abertura) if 'Angulo_Abertura' in globals() and Angulo_Abertura is not None else 180.0
Angulo_Abertura = max(10.0, min(360.0, Angulo_Abertura))

Descida_Membrana = float(Descida_Membrana) if 'Descida_Membrana' in globals() and Descida_Membrana is not None else 0.70
Descida_Membrana = max(0.05, min(1.0, Descida_Membrana))

Num_Estantes = int(Num_Estantes) if 'Num_Estantes' in globals() and Num_Estantes is not None else 6
Num_Travessas = int(Num_Travessas) if 'Num_Travessas' in globals() and Num_Travessas is not None else 10
Raio_Purlin = float(Raio_Purlin) if 'Raio_Purlin' in globals() and Raio_Purlin is not None else 22.0

Puxar_DX = float(Puxar_DX) if 'Puxar_DX' in globals() and Puxar_DX is not None else 0.0
Puxar_DY = float(Puxar_DY) if 'Puxar_DY' in globals() and Puxar_DY is not None else 0.0
Puxar_DZ = float(Puxar_DZ) if 'Puxar_DZ' in globals() and Puxar_DZ is not None else 0.0
Raio_Influencia = float(Raio_Influencia) if 'Raio_Influencia' in globals() and Raio_Influencia is not None else 2800.0

Tolerancia_CNC = float(Tolerancia_CNC) if 'Tolerancia_CNC' in globals() and Tolerancia_CNC is not None else 0.5
Espacamento_2D = float(Espacamento_2D) if 'Espacamento_2D' in globals() and Espacamento_2D is not None else 400.0
Ativar_2D_CNC = bool(Ativar_2D_CNC) if 'Ativar_2D_CNC' in globals() and Ativar_2D_CNC is not None else False

Ancora_X = 0.0
Ancora_Y = 2050.0
Ancora_Z = 2700.0
Ancora = rg.Point3d(Ancora_X, Ancora_Y, Ancora_Z)
Puxao_Vec = rg.Vector3d(Puxar_DX, Puxar_DY, Puxar_DZ)

tol = 0.001

# -------------------------------------------------------------
# 2. FUNÃÃES AUXILIARES DE INTERPOLAÃÃO DE GRAFOS
# -------------------------------------------------------------
def sample_graph(graph_input, u):
    """Interpola linearmente um sinal do Graph Mapper normalizado [0, 1]."""
    if graph_input is None:
        return u
    try:
        items = list(graph_input)
    except:
        return float(graph_input)
        
    n = len(items)
    if n == 0:
        return u
    if n == 1:
        return float(items[0])
    
    clamped_u = max(0.0, min(1.0, float(u)))
    idx = clamped_u * (n - 1)
    i0 = int(idx)
    i1 = min(i0 + 1, n - 1)
    frac = idx - i0
    return float(items[i0]) * (1.0 - frac) + float(items[i1]) * frac

def make_solid_rib(crv_ext, crv_int, thickness, tolerance):
    loft_res = rg.Brep.CreateFromLoft([crv_ext, crv_int], rg.Point3d.Unset, rg.Point3d.Unset, rg.LoftType.Straight, False)
    if not loft_res or len(loft_res) == 0:
        return None
    face = loft_res[0].Faces[0]
    solid = rg.Brep.CreateFromOffsetFace(face, thickness, tolerance, False, True)
    if solid and solid.IsValid:
        u_mid = (face.Domain(0).Min + face.Domain(0).Max) * 0.5
        v_mid = (face.Domain(1).Min + face.Domain(1).Max) * 0.5
        norm = face.NormalAt(u_mid, v_mid)
        solid.Translate(-norm * (thickness * 0.5))
        return solid
    return None

# -------------------------------------------------------------
# 3. BASE REDONDA CENTRAL (TAMBOR CIRCULAR ANULAR)
# -------------------------------------------------------------
Base_Redonda = []
p_base = rg.Plane(rg.Point3d(0, 0, 0), rg.Vector3d.ZAxis)
c_ext_b = rg.Circle(p_base, R_TAMBOR).ToNurbsCurve()
c_int_b = rg.Circle(p_base, R_FURO).ToNurbsCurve()

planar_ring = rg.Brep.CreatePlanarBreps([c_ext_b, c_int_b], tol)
if planar_ring and len(planar_ring) > 0:
    base_solid = rg.Brep.CreateFromOffsetFace(planar_ring[0].Faces[0], H_Soco, tol, False, True)
    if base_solid and base_solid.IsValid:
        Base_Redonda.append(base_solid)

# -------------------------------------------------------------
# 4. ARCOS RADIAIS PRIMÃRIOS COM GRAFOS BÃZIER
# -------------------------------------------------------------
Arcos = []
rib_mid_curves = []
rib_ext_curves = []
rib_int_curves = []

is_closed = (Angulo_Abertura >= 359.5)
if is_closed:
    step = (2.0 * math.pi) / max(1, Num_Arcos)
    angles = [-math.pi + i * step for i in range(Num_Arcos)]
    n_bays = Num_Arcos
else:
    half_rad = math.radians(Angulo_Abertura) * 0.5
    step = (2.0 * half_rad) / max(1, Num_Arcos - 1)
    angles = [-half_rad + i * step for i in range(Num_Arcos)]
    n_bays = Num_Arcos - 1

bay_indices = [(i, (i + 1) % Num_Arcos) for i in range(n_bays)]

gama = Angulo_Abertura / 360.0
fator_borda_elastic = max(0.0, 1.0 - gama)

if abs(Puxar_DX) > 0.001 or abs(Puxar_DY) > 0.001:
    ang_pull = math.atan2(Puxar_DX, Ancora_Y + Puxar_DY)
else:
    ang_pull = 0.0

theta_infl = math.pi * max(0.4, Raio_Influencia / 2800.0)

# Fatores moduladores do Grafo do Perfil (se conectado)
g_prof_p1 = sample_graph(Grafo_Perfil, 0.25) if 'Grafo_Perfil' in globals() else 0.5
g_prof_p2 = sample_graph(Grafo_Perfil, 0.55) if 'Grafo_Perfil' in globals() else 0.5
g_prof_p3 = sample_graph(Grafo_Perfil, 0.85) if 'Grafo_Perfil' in globals() else 0.5

mod_h_p1 = 850.0 * (0.7 + 0.6 * g_prof_p1)
mod_h_p2 = H_Livre * (0.75 + 0.5 * g_prof_p2)
mod_h_p3 = H_Total * (0.85 + 0.3 * g_prof_p3)

for i, ang in enumerate(angles):
    cos_a, sin_a = math.cos(ang), math.sin(ang)
    rad_vec = rg.Vector3d(sin_a, cos_a, 0.0)
    tan_vec = rg.Vector3d(-cos_a, sin_a, 0.0)
    
    delta_ang = abs(ang - ang_pull)
    xi_ang = min(1.0, delta_ang / theta_infl)
    w_ang = math.cos(xi_ang * (math.pi * 0.5)) ** 2
    
    if is_closed:
        w_borda = 0.0
    else:
        u_norm = float(i) / float(max(1, Num_Arcos - 1))
        xi_borda = abs(2.0 * u_norm - 1.0)
        w_borda = math.cos(xi_borda * (math.pi * 0.5)) * fator_borda_elastic
    
    # Pontos de controlo anatÃ³micos:
    p0 = rg.Point3d(rad_vec.X * R_Core, rad_vec.Y * R_Core, H_Soco)
    
    r1 = R_Core + 80.0 - 20.0 * (1.0 - w_borda)
    p1 = rg.Point3d(rad_vec.X * r1, rad_vec.Y * r1, mod_h_p1)
    
    r2 = 1200.0 + 150.0 * w_borda
    z2 = mod_h_p2 + 150.0 * w_borda
    p2 = rg.Point3d(rad_vec.X * r2, rad_vec.Y * r2, z2)
    
    r3 = 2050.0 + 120.0 * w_borda
    z3 = mod_h_p3 - 140.0 * (1.0 - w_borda)
    p3 = rg.Point3d(rad_vec.X * r3, rad_vec.Y * r3, z3)
    
    p4 = rg.Point3d(rad_vec.X * R_Base, rad_vec.Y * R_Base, 0.0)
    
    p0_def = p0
    p1_def = p1 + Puxao_Vec * (w_ang * 0.15)
    p2_def = p2 + Puxao_Vec * (w_ang * 0.65)
    p3_def = p3 + Puxao_Vec * (w_ang * 1.00)
    p4_def = p4 + rg.Vector3d(Puxao_Vec.X * w_ang * 0.35, Puxao_Vec.Y * w_ang * 0.35, 0.0)
    
    rib_crv = rg.Curve.CreateInterpolatedCurve([p0_def, p1_def, p2_def, p3_def, p4_def], 3)
    if not rib_crv:
        continue
    rib_mid_curves.append(rib_crv)
    
    n_samples = 30
    params = rib_crv.DivideByCount(n_samples, True)
    pts_ext, pts_int = [], []
    if params:
        for p_idx, t in enumerate(params):
            pt = rib_crv.PointAt(t)
            tang = rib_crv.TangentAt(t)
            norm_in_plane = rg.Vector3d.CrossProduct(tang, tan_vec)
            norm_in_plane.Unitize()
            t_rel = float(p_idx) / float(n_samples)
            
            # Taper da secÃ§Ã£o: controlado diretamente pelo Grafo_Taper (se disponÃ­vel)
            if 'Grafo_Taper' in globals() and Grafo_Taper:
                g_val = sample_graph(Grafo_Taper, t_rel)
                w_sec = W_Topo + (W_Estante - W_Topo) * g_val
            else:
                if t_rel > 0.65:
                    w_sec = W_Topo + (W_Estante - W_Topo) * ((t_rel - 0.65) / 0.35)
                else:
                    w_sec = W_Topo
                    
            pts_ext.append(pt + norm_in_plane * (w_sec * 0.5))
            pts_int.append(pt - norm_in_plane * (w_sec * 0.5))
            
        crv_ext = rg.Curve.CreateInterpolatedCurve(pts_ext, 3)
        crv_int = rg.Curve.CreateInterpolatedCurve(pts_int, 3)
        if crv_ext and crv_int:
            rib_ext_curves.append(crv_ext)
            rib_int_curves.append(crv_int)
            b_solid = make_solid_rib(crv_ext, crv_int, Espessura, tol)
            if b_solid:
                Arcos.append(b_solid)

# -------------------------------------------------------------
# 5. ESTANTES DE LIVROS (NICHOS HORIZONTAIS INTERLOCKING)
# -------------------------------------------------------------
Estantes = []
n_st = max(2, int(Num_Estantes))

if 'Grafo_Estantes' in globals() and Grafo_Estantes:
    shelf_t_values = [0.65 + 0.32 * max(0.0, min(1.0, float(v))) for v in Grafo_Estantes]
else:
    shelf_t_values = [0.68 + (0.97 - 0.68) * (float(s) / float(max(1, n_st - 1))) for s in range(n_st)]

for s_idx, t_val in enumerate(shelf_t_values):
    pts_tier_ext = [rib_ext_curves[i].PointAtNormalizedLength(t_val) for i in range(len(rib_ext_curves))]
    pts_tier_int = [rib_int_curves[i].PointAtNormalizedLength(t_val) for i in range(len(rib_int_curves))]
    
    pts_ext_seq = pts_tier_ext + [pts_tier_ext[0]] if is_closed else pts_tier_ext
    pts_int_seq = pts_tier_int + [pts_tier_int[0]] if is_closed else pts_tier_int
    
    ring_crv_ext = rg.Curve.CreateInterpolatedCurve(pts_ext_seq, 3)
    ring_crv_int = rg.Curve.CreateInterpolatedCurve(pts_int_seq, 3)
    
    if not ring_crv_ext or not ring_crv_int:
        continue
        
    t_ext_params = [ring_crv_ext.ClosestPoint(p)[1] for p in pts_ext_seq]
    t_int_params = [ring_crv_int.ClosestPoint(p)[1] for p in pts_int_seq]
    
    for bay_i in range(n_bays):
        tA_e, tB_e = t_ext_params[bay_i], t_ext_params[bay_i + 1]
        tA_i, tB_i = t_int_params[bay_i], t_int_params[bay_i + 1]
        
        seg_ext = ring_crv_ext.Trim(tA_e, tB_e)
        seg_int = ring_crv_int.Trim(tA_i, tB_i)
        
        if seg_ext and seg_int:
            loft_res = rg.Brep.CreateFromLoft([seg_ext, seg_int], rg.Point3d.Unset, rg.Point3d.Unset, rg.LoftType.Straight, False)
            if loft_res and len(loft_res) > 0:
                s_solid = rg.Brep.CreateFromOffsetFace(loft_res[0].Faces[0], Espessura, tol, False, True)
                if not s_solid or not s_solid.IsValid:
                    s_solid = rg.Brep.CreateFromOffsetFace(loft_res[0].Faces[0], -Espessura, tol, False, True)
                if s_solid and s_solid.IsValid:
                    Estantes.append(s_solid)

# -------------------------------------------------------------
# 6. TRAVESSAS DA ABÃBADA (PURLINS DE COBERTURA)
# -------------------------------------------------------------
Travessas = []
t_start = 0.28
t_end = t_start + (1.0 - t_start) * Descida_Membrana
n_purlins = max(3, int(Num_Travessas))

for p_idx in range(1, n_purlins + 1):
    t_purlin = t_start + (t_end - t_start) * (float(p_idx) / float(n_purlins + 1))
    pts_purlin = [rib_ext_curves[i].PointAtNormalizedLength(t_purlin) for i in range(len(rib_ext_curves))]
    pts_purlin_seq = pts_purlin + [pts_purlin[0]] if is_closed else pts_purlin
    
    ring_purlin = rg.Curve.CreateInterpolatedCurve(pts_purlin_seq, 3)
    if not ring_purlin:
        continue
    t_p_params = [ring_purlin.ClosestPoint(p)[1] for p in pts_purlin_seq]
    
    for bay_i in range(n_bays):
        tA, tB = t_p_params[bay_i], t_p_params[bay_i + 1]
        seg_p = ring_purlin.Trim(tA, tB)
        if seg_p:
            bp = rg.Brep.CreatePipe(seg_p, Raio_Purlin, False, rg.PipeCapMode.Flat, True, tol, tol)
            if bp and len(bp) > 0:
                Travessas.append(bp[0])

# -------------------------------------------------------------
# 7. MEMBRANA TÃXTIL ENVOLVENTE (CANOPY QUAD-MESH)
# -------------------------------------------------------------
mesh_m = rg.Mesh()
n_ribs = len(rib_ext_curves)
n_u_samples = max(16, int(32 * Descida_Membrana))

grid_pts = []
for i_rib in range(n_ribs):
    crv = rib_ext_curves[i_rib]
    rib_pts = []
    for su in range(n_u_samples + 1):
        t_param = t_start + (t_end - t_start) * (float(su) / float(n_u_samples))
        pt = crv.PointAtNormalizedLength(t_param)
        rib_pts.append(pt)
    grid_pts.append(rib_pts)

for idx_A, idx_B in bay_indices:
    pts_A = grid_pts[idx_A]
    pts_B = grid_pts[idx_B]
    start_v = mesh_m.Vertices.Count
    for su in range(n_u_samples + 1):
        pt_a = pts_A[su]
        pt_b = pts_B[su]
        pt_mid = (pt_a + pt_b) * 0.5
        mesh_m.Vertices.Add(pt_a + rg.Vector3d(0, 0, 4.0))
        mesh_m.Vertices.Add(pt_mid + rg.Vector3d(0, 0, 4.0))
        mesh_m.Vertices.Add(pt_b + rg.Vector3d(0, 0, 4.0))
        
    for su in range(n_u_samples):
        r0 = start_v + su * 3
        r1 = start_v + (su + 1) * 3
        mesh_m.Faces.AddFace(r0, r0 + 1, r1 + 1, r1)
        mesh_m.Faces.AddFace(r0 + 1, r0 + 2, r1 + 2, r1 + 1)

mesh_m.Normals.ComputeNormals()
mesh_m.Compact()
Membrana = [mesh_m]

# -------------------------------------------------------------
# 8. CÃLCULO DE MÃTRICAS ESTRUTURAIS EM TEMPO REAL
# -------------------------------------------------------------
vol_ribs = sum([b.GetVolume() for b in Arcos if b and b.IsValid]) * 1e-9
vol_shelves = sum([b.GetVolume() for b in Estantes if b and b.IsValid]) * 1e-9
vol_base = sum([b.GetVolume() for b in Base_Redonda if b and b.IsValid]) * 1e-9
vol_total = vol_ribs + vol_shelves + vol_base

area_membrana = 0.0
if mesh_m and mesh_m.IsValid:
    amp = rg.AreaMassProperties.Compute(mesh_m)
    if amp:
        area_membrana = amp.Area * 1e-6

Metricas = [
    "=== PAVILHAO DE MADEIRA: AUDITORIA ESTRUTURAL ===",
    "Raio Exterior: {:.1f} mm | Altura Maxima: {:.1f} mm".format(R_Base, H_Total),
    "Angulo Abertura: {:.1f} deg | Nervuras: {} unidades".format(Angulo_Abertura, len(Arcos)),
    "Volume Nervuras: {:.3f} m3 | Espessura: {:.1f} mm".format(vol_ribs, Espessura),
    "Estantes/Prateleiras: {} nichos ({:.3f} m3)".format(len(Estantes), vol_shelves),
    "Volume Base Redonda: {:.3f} m3".format(vol_base),
    "VOLUME TOTAL MADEIRA: {:.3f} m3".format(vol_total),
    "Travessas/Purlins: {} barrotes curvos".format(len(Travessas)),
    "AREA DE MEMBRANA TEXTIL: {:.2f} m2".format(area_membrana),
    "PLANIFICACAO 2D CNC: {}".format("ATIVADA (PeÃ§as geradas para corte)" if Ativar_2D_CNC else "DESATIVADA (Modo Turbo 3D)"),
    "STATUS: Variedades Fechadas Estanques (Watertight Manifolds)"
]

# -------------------------------------------------------------
# 9. PLANIFICAÃÃO 2D AUTOMÃTICA CNC (CONDICIONADA A TOGGLE)
# -------------------------------------------------------------
Placas_CNC_2D = []
Encaixes_CNC_2D = []
Rotulos_CNC_2D = []
Chapas_CNC_2D = []

if Ativar_2D_CNC:
    w_slot = Espessura + Tolerancia_CNC
    cols_per_row = 6
    col_pitch = 2600.0 + Espacamento_2D
    row_pitch = 2900.0 + Espacamento_2D

    for i in range(len(rib_mid_curves)):
        c_ext = rib_ext_curves[i]
        c_int = rib_int_curves[i]
        
        pt_head = c_ext.PointAtStart
        pt_foot = c_ext.PointAtEnd
        pt_mid = c_ext.PointAtNormalizedLength(0.5)

        v_chord = pt_foot - pt_head
        v_mid = pt_mid - pt_head
        norm = rg.Vector3d.CrossProduct(v_chord, v_mid)
        norm.Unitize()
        xaxis = rg.Vector3d(v_chord)
        xaxis.Unitize()
        yaxis = rg.Vector3d.CrossProduct(norm, xaxis)
        yaxis.Unitize()

        arch_plane = rg.Plane(pt_head, xaxis, yaxis)
        xform_to_2d = rg.Transform.PlaneToPlane(arch_plane, rg.Plane.WorldXY)
        
        c_ext_2d = c_ext.DuplicateCurve()
        c_ext_2d.Transform(xform_to_2d)
        c_int_2d = c_int.DuplicateCurve()
        c_int_2d.Transform(xform_to_2d)
        
        col = i % cols_per_row
        row = i // cols_per_row
        x_origin = 4000.0 + col * col_pitch
        y_origin = row * row_pitch
        
        bbox = c_ext_2d.GetBoundingBox(True)
        xform_pos = rg.Transform.Translation(x_origin - bbox.Min.X, y_origin - bbox.Min.Y, -bbox.Min.Z)
        c_ext_2d.Transform(xform_pos)
        c_int_2d.Transform(xform_pos)
        
        cap_head = rg.Line(c_ext_2d.PointAtStart, c_int_2d.PointAtStart).ToNurbsCurve()
        cap_foot = rg.Line(c_int_2d.PointAtEnd, c_ext_2d.PointAtEnd).ToNurbsCurve()
        outline = rg.Curve.JoinCurves([c_ext_2d, cap_foot, c_int_2d, cap_head], tol)
        
        if outline and len(outline) > 0:
            cut_contour = outline[0]
            
            for s_idx, t_val in enumerate(shelf_t_values):
                pt_i = c_int_2d.PointAtNormalizedLength(t_val)
                t_param = c_int_2d.ClosestPoint(pt_i)[1]
                tang = c_int_2d.TangentAt(t_param)
                tang.Unitize()
                norm_slot = rg.Vector3d(-tang.Y, tang.X, 0.0)
                norm_slot.Unitize()
                pt_e = c_ext_2d.PointAt(c_ext_2d.ClosestPoint(pt_i)[1])
                vec_e = pt_e - pt_i
                if rg.Vector3d.Multiply(norm_slot, vec_e) < 0:
                    norm_slot = -norm_slot
                d_slot = vec_e.Length * 0.5
                
                pA = pt_i - tang * (w_slot * 0.5)
                pB = pA + norm_slot * d_slot
                pC = pB + tang * w_slot
                pD = pt_i + tang * (w_slot * 0.5)
                slot_poly = rg.Polyline([pA, pB, pC, pD, pA]).ToNurbsCurve()
                Encaixes_CNC_2D.append(slot_poly)
                
                rect_tool = rg.Rectangle3d(rg.Plane(pt_i, tang, norm_slot), rg.Interval(-w_slot * 0.5, w_slot * 0.5), rg.Interval(-5.0, d_slot)).ToNurbsCurve()
                diff_res = rg.Curve.CreateBooleanDifference(cut_contour, rect_tool)
                if diff_res and len(diff_res) > 0:
                    cut_contour = diff_res[0]
                    
                te_slot = rg.TextEntity()
                te_slot.PlainText = "E" + str(s_idx + 1)
                te_slot.Plane = rg.Plane(pB + norm_slot * 24.0, rg.Vector3d.ZAxis)
                te_slot.TextHeight = 26.0
                Rotulos_CNC_2D.append(te_slot)
                
            cur_bbox = cut_contour.GetBoundingBox(True)
            planar_brep = rg.Brep.CreatePlanarBreps(cut_contour, tol)
            if planar_brep and len(planar_brep) > 0:
                Placas_CNC_2D.append(planar_brep[0])
            else:
                Placas_CNC_2D.append(cut_contour)
                
            te_main = rg.TextEntity()
            te_main.PlainText = "ARCO-" + str(i + 1).zfill(2) + " | L=" + str(int(c_ext_2d.GetLength())) + "mm"
            te_main.Plane = rg.Plane(rg.Point3d(cur_bbox.Min.X, cur_bbox.Max.Y + 60.0, 0), rg.Vector3d.ZAxis)
            te_main.TextHeight = 44.0
            Rotulos_CNC_2D.append(te_main)
            
            p_r0 = rg.Point3d(cur_bbox.Min.X - 40.0, cur_bbox.Min.Y - 40.0, 0.0)
            p_r1 = rg.Point3d(cur_bbox.Max.X + 40.0, cur_bbox.Max.Y + 140.0, 0.0)
            sheet_rect = rg.Rectangle3d(rg.Plane.WorldXY, p_r0, p_r1).ToNurbsCurve()
            Chapas_CNC_2D.append(sheet_rect)
# ---------- end pavilhao_solver_3d ----------

# ---- group: 03 | SHADERS & MATERIAIS DE VISUALIZACAO (continued)
preview_arcos = CustomPreview(Geometry=pavilhao_solver_3d.Arcos, Material=cor_arcos)
preview_estantes = CustomPreview(Geometry=pavilhao_solver_3d.Estantes, Material=cor_estantes)
preview_base_redonda = CustomPreview(Geometry=pavilhao_solver_3d.Base_Redonda, Material=cor_base_redonda)
preview_travessas = CustomPreview(Geometry=pavilhao_solver_3d.Travessas, Material=cor_travessas)
preview_membrana = CustomPreview(Geometry=pavilhao_solver_3d.Membrana, Material=cor_membrana)

# ---- group: 04 | FABRICO CNC 2D & AUDITORIA ESTRUTURAL (continued)
encaixes_cnc_2d = Data(pavilhao_solver_3d.Encaixes_CNC_2D)
rotulos_cnc_2d = Data(pavilhao_solver_3d.Rotulos_CNC_2D)
chapas_cnc_2d = Data(pavilhao_solver_3d.Chapas_CNC_2D)
placas_cnc_2d = Data(pavilhao_solver_3d.Placas_CNC_2D)
auditoria_estrutural = Panel(pavilhao_solver_3d.Metricas)
